# Grasshopper definition Urban_Emergence.gh (Grasshopper 1.0.7)

# ---- group: Generate Evolving Srf and Analysize Properties
number_slider = Slider(5, range=0..100)
number_slider_2 = Slider(5, range=0..100)
r = Slider(200, range=0..1000)
r_2 = Slider(200, range=0..1000)
mountain = Slider(139, range=0..500)
sea = Slider(10, range=0..500)
min = Slider(-43, range=-100..100)
max = Slider(31, range=-100..100)
numbermovingpoints = Slider(10, range=0..50)
timer = Timer(TimerInterval=1000, Target=random_height)  # disabled
random_height = CSharpScript(
    x=number_slider,
    y=number_slider_2,
    mount=mountain,
    sea=sea,
    min=min,
    max=max,
    n=numbermovingpoints,
    reset=Button(),
    start=Toggle(True))  # -> out, heightList, year; inputs x: Int32, y: Int32, mount: Int32, sea: Int32, min: Int32, max: Int32, n: Int32, reset: Boolean, start: Boolean
# ---------- random_height: C# ----------
    if (reset)
    {
      time = 0;
      for (int i = 0; i < (x + 1) * (y + 1); i++)
      {
        height[i] = 0;
      }
    }
    if (start)
    {
      time++;
    }

    List<int> movingOnce = new List<int>();
    List<int> cbd = new List<int>();


    for (int i = 0; i < x + 1; i++)
    {
      for (int j = 0; j < y + 1; j++)
      {
        if (i > 2 && i < 6 && j > 3 && j < 9)
        {
          cbd.Add(i * (y) +j);
        }
      }
    }

    for (int i = 0; i < n; i++)
    {
      Random random = new Random();
      int randomNumber = random.Next(0, (x + 1) * (y + 1));

      while (movingOnce.Contains(randomNumber) || cbd.Contains(randomNumber))
      {

        randomNumber = random.Next(0, (x + 1) * (y + 1));
      }
      movingOnce.Add(randomNumber);


      if (average >= 0)
      {
        int randomHeight = random.Next(min, 0);
        height[randomNumber] = height[randomNumber] + randomHeight;
        average += randomHeight;
        mountNum++;
        mountSea.Add(randomNumber);
      }

      if (average < 0)
      {
        int randomHeight = random.Next(0, max + 1);
        height[randomNumber] = height[randomNumber] + randomHeight;
        average += randomHeight;
        seaNum++;
        mountSea.Add(randomNumber);
      }
    }

    // Output
    heightList = height;
    year = time;

    // Timer
    time++;
# ---------- random_height: C# additional code ----------
  public int time = 0;
  public int average = 0;
  public int mountNum = 0;
  public int seaNum = 0;
  public int[] height = new int[441];
  public List<int> mountSea = new List<int>();
# ---------- end random_height ----------
surface = CSharpScript(R1=r, R2=r_2, X=number_slider, Y=number_slider_2, heightList=random_height.heightList, year=random_height.year)  # -> out, sur, length, B, C, D; inputs R1: Double, R2: Double, X: Int32, Y: Int32, heightList: list of Int32, year: Int32
# ---------- surface: C# ----------
    // Create points grid
    PointList ptList = new PointList(X, Y, R1, R2, heightList);

    // Create a surface
    Surface srf = NurbsSurface.CreateThroughPoints(ptList.pts, X + 1, Y + 1, 3, 3, false, false);

    // Sea Level
    Point3d pt1 = new Point3d(0,0,0);

    // Output

    sur = srf;
# ---------- surface: C# additional code ----------
  public int year = 0;



  // Create a list of points
  public class PointList
  {

    public PointList(int xn, int yn, double r1, double r2, List<int> Height)
    {
      // Store the side length
      x = xn;
      y = yn;
      int count = 0;

      // Nested for loop to sample x and y in both directions
      for (int i = 0; i < x + 1 ; i++)
      {
        for (int j = 0; j < y + 1; j++)
        {
          // Add points
          pts.Add(new Point3d (i * r1, j * r2, Height[count]));
          count++;
        }
      }
    }

    public int x;
    public int y;
    public List<Point3d> pts = new List<Point3d> ();

  }
# ---------- end surface ----------
scaler = Slider(0.8, range=0..1)
srf = Surface(surface.sur)
box_grid_expression = CSharpScript(resolution=Slider(9, range=0..100), scaler=scaler, srf=srf)  # -> out, BasePts, BaseSquares, ProjectedPts, ProjectedSquares, MeanCurvatures; inputs resolution: Int32, scaler: Double, srf: Surface
# ---------- box_grid_expression: C# usings ----------
using Rhino.Geometry.Intersect;
# ---------- box_grid_expression: C# ----------
    List<Point3d> pts = new List<Point3d>();
    List<Rectangle3d> squares = new List<Rectangle3d>();
    List<Rectangle3d> projectedSquares = new List<Rectangle3d>();
    List<Double> meanCurvatures = new List<Double>();

    BoundingBox bBox = srf.GetBoundingBox(true);
    double rangeX = bBox.Max.X - bBox.Min.X;
    double rangeY = bBox.Max.Y - bBox.Min.Y;

    Point3d bOrigin = bBox.Min;

    double dx = rangeX / (resolution - 1);
    double dy = rangeY / (resolution - 1);

    for(int j = 0; j < resolution; j++){
      double y = dy * j + bOrigin.Y;
      for(int i = 0; i < resolution; i++){
        double x = dx * i + bOrigin.X;
        Point3d tempPt = new Point3d(x, y, 0.0);
        pts.Add(tempPt);
      }
    }


    Brep srfBrep = srf.ToBrep();
    var projectedPts = Intersection.ProjectPointsToBreps(
      new List<Brep> {srfBrep}, // brep on which to project
      pts, new Vector3d(0, 0, 1), // project on Z axis
      doc.ModelAbsoluteTolerance);
    for (int i = 0; i < projectedPts.Length; i++){
      double u, v;
      srf.ClosestPoint(projectedPts[i], out u, out v);
      SurfaceCurvature tempC = srf.CurvatureAt(u, v);
      Point3d elevatedPt = srf.PointAt(u, v);
      meanCurvatures.Add(tempC.Mean);
    }

    double sizeX = scaler * dx * 0.5;
    double sizeY = scaler * dy * 0.5;
    for(int i = 0; i < pts.Count; i++){
      Plane pBase = new Plane(pts[i], Vector3d.XAxis, Vector3d.YAxis);
      //Plane pProjected = new Plane(projectedPts[j * resolution + i], Vector3d.XAxis, Vector3d.YAxis);
      Interval sdx = new Interval(-sizeX, sizeX);
      Interval sdy = new Interval(-sizeY, sizeY);
      Rectangle3d tempSquare = new Rectangle3d(pBase, sdx, sdy);
      //Rectangle3d tempProjected = new Rectangle3d(pProjected, sdx, sdy);
      squares.Add(tempSquare);
      //projectedSquares.Add(tempProjected);
    }

    for(int i = 0; i < projectedPts.Length; i++){
      //Plane pBase = new Plane(pts[i], Vector3d.XAxis, Vector3d.YAxis);
      Plane pProjected = new Plane(projectedPts[i], Vector3d.XAxis, Vector3d.YAxis);
      Interval sdx = new Interval(-sizeX, sizeX);
      Interval sdy = new Interval(-sizeY, sizeY);
      Rectangle3d tempProjected = new Rectangle3d(pProjected, sdx, sdy);
      projectedSquares.Add(tempProjected);
    }

    BasePts = pts;
    BaseSquares = squares;
    ProjectedPts = projectedPts;
    ProjectedSquares = projectedSquares;
    MeanCurvatures = meanCurvatures;
# ---------- end box_grid_expression ----------

# ---- group: Apply Urban Elements To Topo
srf_2 = Surface(box_grid_expression.ProjectedSquares)
pdecon = Deconstruct(Point=box_grid_expression.ProjectedPts)  # -> XComponent, YComponent, ZComponent
bnd = Bounds(Numbers=box_grid_expression.MeanCurvatures)
dedomain = DeconstructDomain(Domain=bnd)  # -> Start, End
bnd_2 = Bounds(Numbers=pdecon.ZComponent)
dedomain_2 = DeconstructDomain(Domain=bnd_2)  # -> Start, End
c_script = CSharpScript(
    Srf=srf,
    Curvature=box_grid_expression.MeanCurvatures,
    CMax=dedomain.End,
    CMin=dedomain.Start,
    Height=pdecon.ZComponent,
    HMax=dedomain_2.End,
    HMin=dedomain_2.Start)  # -> out, Landuse; inputs Srf: Surface, Curvature: Double, CMax: Double, CMin: Double, Height: Double, HMax: Double, HMin: Double
# ---------- c_script: C# ----------
    int idx;
    int coin;
    double CDiff = CMax - CMin;
    double HDiff = HMax - HMin;
    Random rand = new Random();

    //Translate Height & Curvature into Landuse
    if (Height < HMax - HDiff * 0.8 || Height > HMax - HDiff * 0.1)
    {
      coin = GetRandomNumber(0, 100);
      if (coin < 90)
      {
        idx = 4;
      }
      else
      {
        idx = 1;
      }
    }

    else if(Height < HMax - HDiff * 0.77)
    {
      idx = 3;
    }

    else
    {

      coin = GetRandomNumber(0, 100);
      if (coin < 60)
      {
        idx = 1;
      }
      else if (coin > 95)
      {
        idx = 3;
      }
      else if (coin >= 60 && coin < 69)
      {
        idx = 4;
      }
      else
      {
        idx = 2;
      }
      //idx = GetRandomNumber(1, 2);
      //idx = 1;
    }


    Landuse = idx;
# ---------- c_script: C# additional code ----------
  // https://www.jb51.net/article/35909.htm
  public static int GetRandomNumber(int min, int max)
  {
    int rtn = 0;
    Random r = new Random();
    byte[] buffer = Guid.NewGuid().ToByteArray();
    int iSeed = BitConverter.ToInt32(buffer, 0);
    r = new Random(iSeed);
    rtn = r.Next(min, max + 1);
    return rtn;
  }
# ---------- end c_script ----------
c_script_2 = CSharpScript(Srf=srf_2, Index=c_script.Landuse)  # -> out, BvldBody, LandUse, Area; inputs Srf: Surface, Index: Int32
# ---------- c_script_2: C# usings ----------
using Rhino.DocObjects;
# ---------- c_script_2: C# ----------
    List<Extrusion> bld = new List<Extrusion>();
    double attrs;
    List<double> areas = new List<double>();

    //Generate Tree / Building based on Landuse
    if (Index == 4)
    {
      Forest forest = new Forest(Srf);
      bld = forest.growTrees();
      attrs = Index + rand.NextDouble();
    }
    else
    {
      Building home = new Building(Srf, Index);
      bld = home.body;
      attrs = Index + rand.NextDouble();
      areas.Add(home.area);
    }


    BvldBody = bld;
    LandUse = attrs;
    Area = areas;
# ---------- c_script_2: C# additional code ----------
  public static Random rand = new Random();
  public static double height = 20 + rand.NextDouble();

  public class Building{

    //Properties
    public List<Extrusion> body;
    public int storey;
    public double area;

    //Constructor
    public Building(Surface Srf, int attr)
    {
      Rhino.RhinoDoc doc = RhinoDoc.ActiveDoc;
      int low;
      int high;

      double w, h;
      Srf.GetSurfaceSize(out w, out h);
      double s = 2.5;


      if (attr == 1)
      {
        low = 1;
        high = 4;
      }
      else if (attr == 2)
      {
        low = 5;
        high = 8;
      }
      else
      {
        low = 12;
        high = 15;
      }

      int floor = rand.Next(low, high);
      List<Extrusion> body = Stack(doc, Srf, low, high, w, h, s, floor);



      this.storey = body.Count;
      this.body = body;
      this.area = 0.8 * w * 0.8 * h * floor;
    }

    //Methods

    //Generate surface 'center'
    public static Point3d Cen(Rhino.RhinoDoc doc, Surface Srf)
    {
      //Construct BoundingBox
      //var view = doc.Views.ActiveView;
      //var plane = view.ActiveViewport.ConstructionPlane();
      BoundingBox bbox = Srf.GetBoundingBox(true);

      //Get BoundingBox Center
      Point3d pc = bbox.Center;

      //Map BoundingBox Center to Surface
      Point3d ps = bbox.ClosestPoint(pc);

      return ps;
    }

    //Make Extrusion from floor
    public static Extrusion Make_Ex(Rhino.RhinoDoc doc, Surface Srf, double w, double h, double s)
    {
      Point3d origin = Cen(doc, Srf);

      Point3d c1 = new Point3d(origin.X + w / s, origin.Y + h / s, origin.Z);
      Point3d c2 = new Point3d(origin.X + w / s, origin.Y - h / s, origin.Z);
      Point3d c3 = new Point3d(origin.X - w / s, origin.Y + h / s, origin.Z);
      Point3d c4 = new Point3d(origin.X - w / s, origin.Y - h / s, origin.Z);

      Plane rec_plane = new Plane(c1, c2, c3);

      Rectangle3d rec_base = new Rectangle3d(rec_plane, c1, c4);

      Extrusion ex = Extrusion.Create(rec_base.ToNurbsCurve(), -height, true);

      return ex;
    }


    public static List<Extrusion> Stack(Rhino.RhinoDoc doc, Surface Srf, int low, int high, double w, double h, double s, int floor)
    {
      //Generate Random Floor Number
      double gap = rand.NextDouble();

      //Extrusion List for return
      List<Extrusion> exs = new List<Extrusion>();
      exs.Add(Make_Ex(doc, Srf, w, h, s));

      //Translate Vector
      Vector3d trans = new Vector3d(0, 0, height + gap);

      for (int i = 0; i < floor; i++)
      {
        Srf.Translate(trans);

        Extrusion temp_ex = Make_Ex(doc, Srf, w, h, s);

        exs.Add(temp_ex);

      }

      return exs;

    }

  }

  public class Tree{

    public Point3d Origin;
    public double Height;
    public double Radius;

    public Tree(Point3d origin, double height, double radius){
      this.Origin = origin;
      this.Height = height;
      this.Radius = radius;
    }

    public Extrusion getBody(){
      Circle BodyBase = new Circle(this.Origin, this.Radius);
      Extrusion BodyMain = Extrusion.Create(BodyBase.ToNurbsCurve(), this.Height, true);
      return BodyMain;
    }

  }

  public class Forest{

    public double Height;
    public double Radius;
    public int BaseNumber;
    public Surface ReferenceSrf;


    public Forest(Surface referenceSrf){
      this.ReferenceSrf = referenceSrf;
      this.Height = rand.NextDouble() * 20.0;
      this.Radius = rand.NextDouble() * 2.0;
      this.BaseNumber = rand.Next(3, 5);
    }


    // get basenumber * basenumber of origins on surface and grow Trees
    public List<Extrusion> growTrees(){
      List<Extrusion> treeList = new List<Extrusion>();
      List<Point3d> originList = new List<Point3d>();

      Interval uDomain = this.ReferenceSrf.Domain(0);
      Interval vDomain = this.ReferenceSrf.Domain(1);

      double uMin = uDomain.Min;
      double uLen = uDomain.Length;
      double uStep = uLen / this.BaseNumber;
      double vMin = vDomain.Min;
      double vLen = vDomain.Length;
      double vStep = vLen / this.BaseNumber;

      for (int i = 0; i < this.BaseNumber; i++){
        for (int j = 0; j < this.BaseNumber; j++){
          double uTemp = uMin + uStep * i + uStep / 2;
          double vTemp = vMin + vStep * j + vStep / 2;
          Point3d tempLoc = this.ReferenceSrf.PointAt(uTemp, vTemp);
          Tree tempTree = new Tree(tempLoc, this.Height, this.Radius);
          Extrusion tempBody = tempTree.getBody();
          treeList.Add(tempBody);
          originList.Add(tempLoc);
        }
      }
      return treeList;
    }

  }
# ---------- end c_script_2 ----------

# ---- group: Visualize Topo
srf_3 = Surface(box_grid_expression.ProjectedSquares)
area = Area(Geometry=srf_3)  # -> Area, Centroid
pdecon_2 = Deconstruct(Point=area.Centroid)  # -> XComponent, YComponent, ZComponent
pt = ConstructPoint(XCoordinate=pdecon_2.XComponent, YCoordinate=pdecon_2.YComponent, ZCoordinate="-100")
dist = Distance(PointA=pt, PointB=area.Centroid)
Z = UnitZ(Factor=dist)
number_slider_3 = Slider(39, range=0..255)
move = Move(Geometry=srf_3, Motion=expr("-x", Z))  # -> Geometry, Transform
extr = Extrude(Base=move.Geometry, Direction=Z)
rgb = ColourRGB(Alpha=255, Red=number_slider_3, Green=number_slider_3, Blue=number_slider_3)
preview = CustomPreview(Geometry=extr, Material=rgb)

# ---- group: Visualize Urban Elements
gradient = Gradient(
    LowerLimit=Slider(1, range=0..10),
    UpperLimit=Slider(2, range=0..10),
    Parameter=c_script_2.LandUse,
    stops=[0: RGB(171, 201, 211), 0.997: RGB(142, 236, 233)])
gradient_2 = Gradient(
    LowerLimit=Slider(2, range=0..10),
    UpperLimit=Slider(3, range=0..10),
    Parameter=c_script_2.LandUse,
    stops=[0: RGB(204, 155, 206), 0.997: RGB(224, 56, 105)])
gradient_3 = Gradient(
    LowerLimit=Slider(3, range=0..10),
    UpperLimit=Slider(4, range=0..10),
    Parameter=c_script_2.LandUse,
    stops=[0: RGB(250, 237, 185), 0.997: RGB(243, 202, 105)])
gradient_4 = Gradient(
    LowerLimit=Slider(4, range=0..10),
    UpperLimit=Slider(5, range=0..10),
    Parameter=c_script_2.LandUse,
    stops=[0: RGB(226, 243, 178), 0.997: RGB(116, 145, 102)])
c_script_3 = CSharpScript(attr=c_script_2.LandUse, C1=gradient, C2=gradient_2, C3=gradient_3, C4=gradient_4)  # -> out, graft(A); inputs attr: Double, C1: Color, C2: Color, C3: Color, C4: Color
# ---------- c_script_3: C# usings ----------
using System.Drawing;
# ---------- c_script_3: C# ----------
    Color x = new Color();
    if (attr >= 1.0 && attr < 2.0)
    {
      x = C1;
    }
    else if (attr >= 2 && attr < 3)
    {
      x = C2;
    }
    else if (attr >= 3 && attr < 4)
    {
      x = C3;
    }
    else
    {
      x = C4;
    }

    A = x;
# ---------- end c_script_3 ----------
preview_2 = CustomPreview(Geometry=c_script_2.BvldBody, Material=c_script_3.A)

# ---- group: Figures
pt_2 = Point(<point referenced from the Rhino model>)
pt_3 = Point(<point referenced from the Rhino model>)
pt_4 = Point(<point referenced from the Rhino model>)
pt_5 = Point(<point referenced from the Rhino model>)
pt_6 = Point(<point referenced from the Rhino model>)

panel = Panel("LOW RISE ")
panel_2 = Panel("HIGH RISE ")
panel_3 = Panel("MID RISE ")
panel_4 = Panel("OPEN SPACE ")
panel_5 = Panel("DENSITY ")

c_script_4 = CSharpScript(landuses=c_script.Landuse)  # -> out, Ratio1, Ratio2, Ratio3, Ratio4; inputs landuses: list of Int32
# ---------- c_script_4: C# ----------
    double open = 0;
    double low = 0;
    double medium = 0;
    double high = 0;
    double all = landuses.Count;

    for (int i = 0; i < all; i++){
      if (landuses[i] == 1){
        low++;
      }
      else if (landuses[i] == 2){
        medium++;
      }
      else if (landuses[i] == 3){
        high++;
      }
      else{
        open++;
      }
    }

    double ratio1 = low / all;
    double ratio2 = medium / all;
    double ratio3 = high / all;
    double ratio4 = open / all;

    Ratio1 = ratio1;
    Ratio2 = ratio2;
    Ratio3 = ratio3;
    Ratio4 = ratio4;
# ---------- end c_script_4 ----------
number_slider_4 = Slider(20, range=0..100)
ma = MassAddition(Input=flatten(c_script_2.Area))  # -> Result, PartialResults
ma_2 = MassAddition(Input=area.Area)  # -> Result, PartialResults
c_script_5 = CSharpScript(x=ma.Result, y=ma_2.Result)  # -> out, A; inputs x: Double, y: Double
# ---------- c_script_5: C# ----------
    A = x / y;
# ---------- end c_script_5 ----------
merge = Merge(Data1=panel_2, Data2=c_script_4.Ratio1)  # -> flatten(Result)
join = TextJoin(Text=merge)
merge_2 = Merge(Data1=panel_3, Data2=c_script_4.Ratio2)  # -> flatten(Result)
join_2 = TextJoin(Text=merge_2)
merge_3 = Merge(Data1=panel, Data2=c_script_4.Ratio1)  # -> flatten(Result)
join_3 = TextJoin(Text=merge_3)
merge_4 = Merge(Data1=panel_4, Data2=c_script_4.Ratio3)  # -> flatten(Result)
join_4 = TextJoin(Text=merge_4)
merge_5 = Merge(Data1=panel_5, Data2=c_script_5.A)  # -> flatten(Result)
join_5 = TextJoin(Text=merge_5)
tag = TextTag3D(Location=pt_2, Text=join, Size=number_slider_4, Colour=gradient, Justification=7)
tag_2 = TextTag3D(Location=pt_5, Text=join_4, Size=number_slider_4, Colour=gradient_4, Justification=7)
tag_3 = TextTag3D(Location=pt_4, Text=join_3, Size=number_slider_4, Colour=gradient_3, Justification=7)
tag_4 = TextTag3D(Location=pt_6, Text=join_5, Size=number_slider_4, Justification=7)
tag_5 = TextTag3D(Location=pt_3, Text=join_2, Size=number_slider_4, Colour=gradient_2, Justification=7)
